# Grasshopper definition Beam6DOF.gh (Grasshopper 1.0.7)
# plug-ins: K2Engineering, Kangaroo2 Components

# ---- group: Geometry
rad = Radians(Degrees=Slider(20, range=-180..180))
# K2ENGINEERING - BEAM 6 DOF
X = UnitX(Factor=1)
pt = ConstructPoint(XCoordinate=0, YCoordinate=0, ZCoordinate=0)
rotate = Rotate(Geometry=X, Angle=rad, Plane=PlaneXY(0, 0, 0))  # -> Geometry, Transform
line = LineSDL(Start=pt, Direction=rotate.Geometry, Length=Slider(4, range=0..10))
Z = UnitZ(Factor=1)
xprod = CrossProduct(VectorA=rotate.Geometry, VectorB=Z, Unitize=False)  # -> Vector, Length
end = EndPoints(Curve=line)  # -> Start, End
line_2 = LineSDL(Start=end.End, Direction=xprod.Vector, Length=Slider(2, range=0..10))
crv = Curve(flatten([line, line_2]))
end_2 = EndPoints(Curve=line_2)  # -> Start, End
len = Length(Curve=crv)
pt_2 = Point(end_2.End)
division = Division(A=len, B="0.2")
int = Integer(division)
divide = DivideCurve(Curve=crv, Count=int, Kinks=False)  # -> Points, Tangents, Parameters
pline = PolyLine(Vertices=divide.Points, Closed=False)  # -> flatten(Polyline)
join = JoinCurves(Curves=pline, Preserve=False)
kn = Panel("1")
explode = Explode(Curve=join, Recursive=True)  # -> Segments, Vertices
Z_2 = UnitZ(Factor=expr("-X", kn))
beam_segments = Curve(explode.Segments)
load_pt = Point(pt_2)
load_vec = Vector(Z_2)

# ----
crv_2 = Curve(beam_segments)
beamorientation = BeamOrientation(Line=crv_2, FlipVertical=Toggle(False))  # -> StartPlane, EndPlane
pln = Plane(beamorientation.EndPlane)
pln_2 = Plane(beamorientation.StartPlane)

mat = Materials(MaterialIndex=Slider(0, range=0..10))  # -> MaterialName, Density, YoungsModulus, ShearModulus, Strength
w_mm = Panel("100")
h_mm = Panel("200")
t_mm = Panel("5")
panel = Panel(mat.MaterialName)
rectangle = RectangularCS(Width=w_mm, Height=h_mm, Thickness=t_mm)  # -> A, Iy, Iz, It
beam = Beam(
    StartPlane=pln_2,
    EndPlane=pln,
    EModulus=mat.YoungsModulus,
    GModulus=mat.ShearModulus,
    A=rectangle.A,
    Iy=rectangle.Iy,
    Iz=rectangle.Iz,
    It=rectangle.It)

item = ListItem(List=pln_2, Index=0, Wrap=True)
toggle = BooleanToggle(True)
pt_3 = Point(item)
support6dof = Support6DOF(
    SupportPt=pt_3,
    XFixed=toggle,
    YFixed=toggle,
    ZFixed=toggle,
    RXFixed=Toggle(True),
    RYFixed=Toggle(True),
    RZFixed=Toggle(True),
    Strength="1e9")

vec = Vector(load_vec)
pt_4 = Point(load_pt)
N = Vector(expr("X*1e3", vec))
load = Load(Point=pt_4, NodalForce=N)

duppt = RemoveDuplicatePts(Points=flatten([pln_2, pln]), Tolerance=0.01)
show = Show(G=duppt)

entwine = Entwine(Branch00=show, Branch01=support6dof, Branch02=beam, Branch03=load, FlattenInputs=True)
solver = Solver(GoalObjects=entwine, Reset=Button(), Threshold="1e-20", Tolerance=0.01, On=Toggle(False))  # -> I, V, O
bang = ExplodeTree(Data=solver.O)  # -> Branch0, Branch1, Branch2, Branch3

support6dofoutput = Support6DOFOutput(Support6DOFData=bang.Branch1)  # -> SupportPlane, ReactionForce, ReactionMoment
xy = XYPlane(Origin=Point(0, 0, 0))
rotate_2 = Rotate(Geometry=xy, Angle=rad, Plane=PlaneXY(0, 0, 0))  # -> Geometry, Transform
pln_3 = Plane(support6dofoutput.SupportPlane)
vec_2 = Vector(expr("Round(X,1)", support6dofoutput.ReactionForce))
transformmoment = TransformMoment(Moment=support6dofoutput.ReactionMoment, Plane1=xy, Plane2=rotate_2.Geometry)
vdis = VectorDisplay(Anchor=support6dofoutput.SupportPlane, Vector=expr("X*1e-1", support6dofoutput.ReactionForce))
panel_2 = Panel(vec_2)
vec_3 = Vector(expr("Round(X,1)", support6dofoutput.ReactionMoment))
vec_4 = Vector(expr("Round(X,1)", transformmoment))
global_reaction_moment = Panel(vec_3)
reaction_moment_aligned_with_beam = Panel(vec_4)

displ = Displacements(InitialPositions=duppt, FinalPositions=bang.Branch0)  # -> TotalDisplacements, MaximumDisplacementX, MaximumDisplacementY, MaximumDisplacementZ
vlen = VectorLength(Vector=displ.TotalDisplacements)
sort = SortList(Keys=vlen, ValuesA=bang.Branch0)  # -> reverse(Keys), reverse(ValuesA)
item_2 = ListItem(List=sort.ValuesA, Index=0, Wrap=True)
item_3 = ListItem(List=sort.Keys, Index=0, Wrap=True)
int_2 = Integer(item_3)
pt_5 = Point(item_2)
panel_3 = Panel(int_2)

beamoutput = BeamOutput(BeamData=bang.Branch2)  # -> P0, P1, N, Vy, Vz, Mt, My0, Mz0, My1, Mz1
abs = Absolute(Value=[beamoutput.My0, beamoutput.My1])
abs_2 = Absolute(Value=beamoutput.Vy)
abs_3 = Absolute(Value=beamoutput.Mt)
abs_4 = Absolute(Value=[beamoutput.Mz0, beamoutput.Mz1])
abs_5 = Absolute(Value=beamoutput.Vz)
sort_2 = SortList(Keys=abs)  # -> reverse(Keys), ValuesA
sort_3 = SortList(Keys=abs_2)  # -> reverse(Keys), ValuesA
sort_4 = SortList(Keys=abs_3)  # -> reverse(Keys), ValuesA
sort_5 = SortList(Keys=abs_4)  # -> reverse(Keys), ValuesA
sort_6 = SortList(Keys=abs_5)  # -> reverse(Keys), ValuesA
item_4 = ListItem(List=sort_2.Keys, Index=0, Wrap=True)
item_5 = ListItem(List=sort_3.Keys, Index=0, Wrap=True)
item_6 = ListItem(List=sort_4.Keys, Index=0, Wrap=True)
item_7 = ListItem(List=sort_5.Keys, Index=0, Wrap=True)
item_8 = ListItem(List=sort_6.Keys, Index=0, Wrap=True)
list = ValueList({"Vy": 0, "Vz": 1, "Mt": 2, "My": 3, "Mz": 4}, selected="My")
ln = Line(StartPoint=beamoutput.P0, EndPoint=beamoutput.P1)
my_max_knm = Panel(item_4)
mt_max_knm = Panel(item_6)
mz_max_knm = Panel(item_7)
vy_max_kn = Panel(item_5)
vz_max_kn = Panel(item_8)
axialdisplay = AxialVisualisation(Line=ln, AxialForces=beamoutput.N, ThicknessMax=10)
bendingdisplay = BendingVisualisation6DOF(
    P0=beamoutput.P0,
    P1=beamoutput.P1,
    Vy=beamoutput.Vy,
    Vz=beamoutput.Vz,
    Mt=beamoutput.Mt,
    My0=beamoutput.My0,
    Mz0=beamoutput.Mz0,
    My1=beamoutput.My1,
    Mz1=beamoutput.Mz1,
    Option=list,
    ScaleFactor=Slider(1.5, range=0..10),
    Colour=ColourSwatch(SwatchColor=RGB(0, 187, 255)))

h = Number(expr("X*1e-3", h_mm))
w = Number(expr("X*1e-3", w_mm))
dom = ConstructDomain(DomainStart=expr("-X/2", w), DomainEnd=expr("X/2", w))
dom_2 = ConstructDomain(DomainStart=expr("-X/2", h), DomainEnd=expr("X/2", h))
rectangle_2 = Rectangle(Plane=beamoutput.P0, XSize=dom, YSize=dom_2, Radius=0)  # -> graft(Rectangle), Length
rectangle_3 = Rectangle(Plane=beamoutput.P1, XSize=dom, YSize=dom_2, Radius=0)  # -> graft(Rectangle), Length
loft = Loft(
    Curves=[rectangle_2.Rectangle, rectangle_3.Rectangle],
    Options={Adjust=False, Closed=False, LoftEnds=0, LoftSimp=0, LoftType=0, Rebuild=10, Refit=0.01})
