# Grasshopper definition Cablenet.gh (Grasshopper 1.0.7)
# plug-ins: K2Engineering, MeshEdit Components, Human, PlanktonGh, Weaverbird, Kangaroo2 Components

# ---- group: Input 10 x 10 m square net
# K2ENGINEERING - CABLENET
mesh = Mesh(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)
diag = Diagonalize(Mesh=mesh)

# ----
dl_s_w = Panel("""1,0,0
1.35,1.0,1.5
1.35,1.5,1.0""")
split = TextSplit(Text=dl_s_w, Separators=",")  # -> simplify(Result)
lc = Slider(1, range=0..2)
branch = TreeBranch(Tree=split, Path=lc, MaintainPaths=True)
item = ListItem(List=branch, Index=0, Wrap=True)  # -> Item, Item1, Item2
dl_factor = Number(item.Item)
s_factor = Number(item.Item1)
w_factor = Number(item.Item2)

# ---- group: K2 form-finding
medges = MeshEdges(Mesh=diag)  # -> NakedEdges, InteriorEdges, NonManifoldEdges
number_slider = Slider(100, range=0..1000)
number_slider_2 = Slider(0, range=0..1)
number_slider_3 = Slider(10, range=0..1000)
rad = Radians(Degrees=Slider(100, range=0..180))
mc = MeshCorners(Mesh=diag, Angle=rad)
anchor = Anchor(Point=mc, Strength=10000000)
show = Show(G=mc)

# ----
crv = Curve(medges.NakedEdges)
crv_2 = Curve(medges.InteriorEdges)

# ---- group: K2 form-finding (continued)
len = Length(Curve=crv)
len_2 = Length(Curve=crv_2)
multiplication = Multiplication(A=len_2, B=Slider(0, range=0..1))
length_line = LengthLine(Line=crv_2, Length=multiplication, Strength=number_slider_3)

# ----
multiplication_2 = Multiplication(A=len, B=number_slider_2)

# ---- group: K2 form-finding (continued)
length_line_2 = LengthLine(Line=crv, Length=multiplication_2, Strength=number_slider)
entwine = Entwine(Branch00=show, Branch01=anchor, Branch02=length_line_2, Branch03=length_line, FlattenInputs=True)
solver = Solver(GoalObjects=entwine, Reset=Button(), Threshold=1e-15, Tolerance=0.01, On=Toggle(False))  # -> I, V, O
bang = ExplodeTree(Data=solver.O)  # -> Branch0, Branch1, Branch2, Branch3
supports = Point(bang.Branch0)
ff_edges = Curve(bang.Branch2)

# ----
ff_inner = Curve(bang.Branch3)

# ---- group: K2 form-finding (continued)
previewlw = CustomPreviewLineweights(
    Geometry=[ff_edges, ff_inner],
    Shader=ColourSwatch(SwatchColor=RGB(255, 212, 0)),
    Thickness=Slider(2, range=0..10),
    Absolute=False)

# ---- group: Send form-finding result to structural analysis
structural_analysis = BooleanToggle(False)
filter = StreamFilter(Gate=structural_analysis, Stream1=supports)
filter_2 = StreamFilter(Gate=structural_analysis, Stream1=ff_edges)
filter_3 = StreamFilter(Gate=structural_analysis, Stream1=ff_inner)

# ----
crv_3 = Curve(filter_3)
crv_4 = Curve(filter_2)
wbweave = WeaverbirdsMeshFromLinesWeaveBack(Lines=flatten([crv_4, crv_3]), MaximumValence=4)
mesh_2 = Mesh(wbweave)
tri = Triangulate(Mesh=mesh_2)  # -> Mesh, Count
flip = MeshFlip(Mesh=tri.Mesh)
pmesh = PlanktonMesh(flip)

entwine_2 = Entwine(Branch00=multiplication_2, Branch01=multiplication, FlattenInputs=True)
entwine_3 = Entwine(Branch00=number_slider, Branch01=number_slider_3, FlattenInputs=True)
entwine_4 = Entwine(Branch00=filter_2, Branch01=filter_3, FlattenInputs=True)
max_pretension_n = Panel("10e3")
len_3 = Length(Curve=entwine_4)
pt = Pretension(RestLength=entwine_2, Strength=entwine_3, FFLength=len_3, MaxPretension=max_pretension_n)
mat = Materials(MaterialIndex=Slider(0, range=0..5))  # -> MaterialName, Density, YoungsModulus, ShearModulus, Strength
circle = CircularCS(Diameter=Slider(10, range=0..10))  # -> A, I, Z, It
circle_2 = CircularCS(Diameter=Slider(20, range=0..20))  # -> A, I, Z, It
panel = Panel(mat.MaterialName)
bang_2 = ExplodeTree(Data=pt)  # -> Branch0, Branch1
cable = Cable(Line=filter_2, EModulus=mat.YoungsModulus, Area=circle_2.A, PreTension=bang_2.Branch0)
cable_2 = Cable(Line=filter_3, EModulus=mat.YoungsModulus, Area=circle.A, PreTension=bang_2.Branch1)

# ---- group: Cables selfweight
blength = BarLength(Bars=crv_3)  # -> Points, NodalLengths
# External load and load cases
blength_2 = BarLength(Bars=crv_4)  # -> Points, NodalLengths
bselfweight = BarSelfweight(NodalLengths=blength_2.NodalLengths, CrossSectionArea=circle_2.A, MaterialDensity=mat.Density)
bselfweight_2 = BarSelfweight(NodalLengths=blength.NodalLengths, CrossSectionArea=circle.A, MaterialDensity=mat.Density)
multiplication_3 = Multiplication(A=bselfweight_2, B=dl_factor)
multiplication_4 = Multiplication(A=bselfweight, B=dl_factor)
vdis = VectorDisplay(Anchor=blength_2.Points, Vector=expr("X/10", multiplication_4))
load = Load(Point=blength.Points, NodalForce=multiplication_3)
vdis_2 = VectorDisplay(Anchor=blength.Points, Vector=expr("X/10", multiplication_3))
load_2 = Load(Point=blength_2.Points, NodalForce=multiplication_4)

# ----
end = EndPoints(Curve=flatten([crv_4, crv_3]))  # -> Start, End
duppt = RemoveDuplicatePts(Points=flatten([end.Start, end.End]), Tolerance=0.01)
show_2 = Show(G=duppt)

support = Support(PinnedSupportPt=filter, XFixed=True, YFixed=True, ZFixed=True, Strength=1e+15)
ma = MassAddition(Input=flatten([multiplication_4, multiplication_3]))  # -> Result, PartialResults
vlen = VectorLength(Vector=ma.Result)
kg = Number(expr("X/10", vlen))
int = Integer(kg)
panel_2 = Panel(int)

# ---- group: wind
panel_3 = Panel("1.0")  # "kN/m2"
X = UnitX(Factor=panel_3)

# ----
pl = PlaneNormal(Origin=Point(0, 0, 0), ZAxis=X)

# ---- group: wind (continued)
mvarea = MeshVertexArea(PlanktonMesh=pmesh, ProjectToPlane=pl)  # -> Vertices, VertexNormals
vdis_3 = VectorDisplay(Anchor=mvarea.Vertices, Vector=expr("X*10", mvarea.VertexNormals))
mwind = MeshWindLoad(Wind=X, VertexNormals=mvarea.VertexNormals, Option=Toggle(True))
multiplication_5 = Multiplication(A=mwind, B=w_factor)
load_3 = Load(Point=mvarea.Vertices, NodalForce=multiplication_5)
vdis_4 = VectorDisplay(Anchor=mvarea.Vertices, Vector=expr("X/100", multiplication_5))

# ---- group: snow
xy = XYPlane(Origin=Point(0, 0, 0))
panel_4 = Panel("1.0")  # "kN/m2"
toggle = BooleanToggle(True)
Z = UnitZ(Factor=expr("-X", panel_4))

# ----
mvarea_2 = MeshVertexArea(PlanktonMesh=pmesh, ProjectToPlane=xy)  # -> Vertices, VertexNormals
msnow = MeshSnowLoad(Snow=Z, VertexNormals=mvarea_2.VertexNormals, Option=toggle)

# ---- group: snow (continued)
multiplication_6 = Multiplication(A=msnow, B=s_factor)
load_4 = Load(Point=mvarea_2.Vertices, NodalForce=multiplication_6)
vdis_5 = VectorDisplay(Anchor=mvarea_2.Vertices, Vector=expr("X/100", multiplication_6))

# ----
entwine_5 = Entwine(Branch00=load_2, Branch01=load, Branch02=load_4, Branch03=load_3, FlattenInputs=True)
entwine_6 = Entwine(Branch00=show_2, Branch01=support, Branch02=cable, Branch03=cable_2, Branch04=entwine_5, FlattenInputs=True)
solver_2 = Solver(GoalObjects=entwine_6, Reset=Button(), Threshold=1e-15, Tolerance=0.01, On=Toggle(False))  # -> I, V, O
bang_3 = ExplodeTree(Data=solver_2.O)  # -> Branch0, Branch1, Branch2, Branch3, Branch4

pt_2 = Point(bang_3.Branch0)
displ = Displacements(InitialPositions=duppt, FinalPositions=pt_2)  # -> TotalDisplacements, MaximumDisplacementX, MaximumDisplacementY, MaximumDisplacementZ
vlen_2 = VectorLength(Vector=displ.TotalDisplacements)
int_2 = Integer(vlen_2)
sort = SortList(Keys=int_2)  # -> reverse(Keys), ValuesA
item_2 = ListItem(List=sort.Keys, Index=0, Wrap=True)
gradient = Gradient(
    LowerLimit=item_2,
    UpperLimit="0",
    Parameter=int_2,
    stops=[0: RGB(234, 38, 0), 0.25: RGB(234, 126, 0), 0.5: RGB(254, 244, 84), 0.75: RGB(173, 203, 249), 1: RGB(75, 107, 169)])
max_displ_mm = Panel(item_2)
dots = DotDisplay(Point=pt_2, Colour=gradient, Size=0.15)

supportoutput = SupportOutput(SupportData=bang_3.Branch1)  # -> SupportPt, ReactionForce
vdis_6 = VectorDisplay(Anchor=supportoutput.SupportPt, Vector=expr("X*1e-1", supportoutput.ReactionForce))

baroutput = BarOutput(BarData=bang_3.Branch3)  # -> Line, AxialForce, AxialStress
baroutput_2 = BarOutput(BarData=bang_3.Branch2)  # -> Line, AxialForce, AxialStress
entwine_7 = Entwine(Branch00=baroutput_2.Line, Branch01=baroutput.Line, FlattenInputs=True)  # -> flatten(Result)
entwine_8 = Entwine(Branch00=baroutput_2.AxialForce, Branch01=baroutput.AxialForce, FlattenInputs=True)  # -> flatten(Result)
entwine_9 = Entwine(Branch00=baroutput_2.AxialStress, Branch01=baroutput.AxialStress, FlattenInputs=True)  # -> flatten(Result)
sort_2 = SortList(Keys=entwine_8)  # -> reverse(Keys), ValuesA
item_3 = ListItem(List=sort_2.Keys, Index=0, Wrap=True)
max_force_kn = Panel(item_3)
axialdisplay = AxialVisualisation(Line=entwine_7, AxialForces=entwine_9, ThicknessMax=Slider(12, range=0..100))
