# Grasshopper definition Frame.gh (Grasshopper 0.9.76)
# plug-ins: K2Engineering, Kangaroo2 Components

# ---- group: Frame polyline
# K2ENGINEERING - FRAME
crv = Curve(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)

# ---- group: CHS50 steel
mat = Materials(MaterialIndex=Slider(0, range=0..5))  # -> MaterialName, Density, YoungsModulus, Strength
circle = CircularCS(Diameter=Slider(60.3, range=0..100), Thickness=Slider(3.65, range=0..10))  # -> Area, Inertia, ZDist
panel = Panel(mat.MaterialName)

# ----
divdist = DivideDistance(Curve=crv, Distance="0.1")  # -> Points, Tangents, Parameters
pline = PolyLine(Vertices=divdist.Points, Closed=False)
explode = Explode(Curve=pline, Recursive=True)  # -> Segments, Vertices

crv_2 = Curve(explode.Segments)
lng = ListLength(List=crv_2)  # -> expr("X-1", Length)
shift = ShiftList(List=crv_2, Shift=1, Wrap=False)
cull_i = CullIndex(List=crv_2, Indices=lng, Wrap=False)
rod = Rod(
    LineA=cull_i,
    LineB=shift,
    EModulus=mat.YoungsModulus,
    Inertia=circle.Inertia,
    ZDistance=circle.ZDist,
    RestAngleOption=Slider(1, range=0..1))
bar = Bar(Line=crv_2, EModulus=mat.YoungsModulus, Area=circle.Area)

# ---- group: Point load
pt = Point(explode.Vertices)
f_n = Slider(1500, range=0..10000)
lng_2 = ListLength(List=pt)  # -> expr("(X-1)/2", Length)
item = ListItem(List=pt, Index=lng_2, Wrap=True)
Z = UnitZ(Factor=f_n)  # -> expr("-X", UnitVector)
load = Load(Point=item, NodalForce=Z)
vdis = VectorDisplay(Anchor=item, Vector=expr("X/1000", Z))

# ---- group: Selfweight
crv_3 = Curve(explode.Segments)
blength = BarLength(Bars=crv_3)  # -> Points, NodalLengths
bselfweight = BarSelfweight(NodalLengths=blength.NodalLengths, CrossSectionArea=circle.Area, MaterialDensity=mat.Density)
vdis_2 = VectorDisplay(Anchor=blength.Points, Vector=expr("X/10", bselfweight))
load_2 = Load(Point=blength.Points, NodalForce=bselfweight)

# ----
end = EndPoints(Curve=crv)  # -> Start, End
support = Support(PinnedSupportPt=[end.Start, end.End], XFixed=True, YFixed=True, ZFixed=True, Strength=1e+15)

pt_2 = Point(explode.Vertices)
show = Show(G=pt_2)
entwine = Entwine(Branch00=show, Branch01=support, Branch02=bar, Branch03=rod, Branch04=[load_2, load], FlattenInputs=True)
solver = Solver(GoalObjects=entwine, Reset=Button(), Threshold="1e-15", Tolerance=0.01, On=Toggle(False))  # -> I, V, O
bang = ExplodeTree(Data=solver.O)  # -> Branch0, Branch1, Branch2, Branch3, Branch4

# ---- group: Reactions
supportoutput = SupportOutput(SupportData=bang.Branch1)  # -> SupportPt, ReactionForce
multiplication = Multiplication(A=supportoutput.ReactionForce, B="-0.1")
vdis_3 = VectorDisplay(Anchor=supportoutput.SupportPt, Vector=supportoutput.ReactionForce)
move = Move(Geometry=supportoutput.SupportPt, Motion=multiplication)  # -> Geometry, Transform
expression = Expression(x=supportoutput.ReactionForce, Expression="Round(x,2)")
xz = XZPlane(Origin=move.Geometry)
tag = TextTag3D(
    Location=xz,
    Text=expression,
    Size=Slider(0.1, range=0..1),
    Colour=ColourSwatch(SwatchColor=RGB(0, 0, 0)),
    Justification=5)

# ----
baroutput = BarOutput(BarData=bang.Branch2)  # -> PIndexStart, PIndexEnd, Line, AxialForce, AxialStress

# ---- group: Moment and shear
number_slider = Slider(0.5, range=0..10)
rodoutput = RodOutput(RodData=bang.Branch3)  # -> PIndexBending, Plane, BendingMoment, BendingStress
bendingdisplay = BendingVisualisation(BendingPlanes=rodoutput.Plane, BendingStresses=rodoutput.BendingStress, ScaleFactor=number_slider)
crv_4 = Curve(baroutput.Line)
shear = Shear(Line=crv_4, BendingMoment=rodoutput.BendingMoment, BendingPlane=rodoutput.Plane)
vec = Vector(expr("Round(X,3)", shear))
sheardisplay = ShearVisualisation(Line=crv_4, ShearVectors=vec, ScaleFactor=number_slider)

# ---- group: Displacement
range = Range(Domain=Domain(0, 1), Steps=20)
gradient = Gradient(LowerLimit=0, UpperLimit=1, Parameter=range, stops=[0: RGB(0, 128, 0), 0.5: RGB(255, 255, 0), 1: RGB(255, 0, 0)])
displ = Displacements(InitialPositions=explode.Vertices, FinalPositions=bang.Branch0)  # -> TotalDisplacements, MaximumDisplacementX, MaximumDisplacementY, MaximumDisplacementZ
vlen = VectorLength(Vector=displ.TotalDisplacements)
displ_mm = Panel(displ.MaximumDisplacementZ)
displvis = DisplacementVisualisation(Lines=baroutput.Line, DisplacedNodes=bang.Branch0, Displacement=vlen, ColourRange=gradient)

# ----
axialdisplay = AxialVisualisation(Line=baroutput.Line, AxialStresses=baroutput.AxialStress)
