# Grasshopper definition Frame6DOF.gh (Grasshopper 1.0.7)
# plug-ins: K2Engineering, Kangaroo2 Components

# ---- group: Geometry
number_slider = Slider(3, range=0..10)
# K2ENGINEERING - FRAME 6 DOF
number_slider_2 = Slider(5, range=0..10)
pt = ConstructPoint(XCoordinate=0, YCoordinate=0, ZCoordinate=0)
pt_2 = ConstructPoint(XCoordinate=0, YCoordinate=0, ZCoordinate=number_slider)
pt_3 = ConstructPoint(XCoordinate=number_slider_2, YCoordinate=0, ZCoordinate=number_slider)
pt_4 = ConstructPoint(XCoordinate=number_slider_2, YCoordinate=0, ZCoordinate=0)
pline = PolyLine(Vertices=flatten([pt, pt_2, pt_3, pt_4]), Closed=False)
explode = Explode(Curve=pline, Recursive=True)  # -> Segments, Vertices
len = Length(Curve=explode.Segments)
division = Division(A=len, B="0.25")
int = Integer(division)
divide = DivideCurve(Curve=explode.Segments, Count=int, Kinks=False)  # -> Points, Tangents, Parameters
pline_2 = PolyLine(Vertices=divide.Points, Closed=False)
explode_2 = Explode(Curve=pline_2, Recursive=True)  # -> flatten(Segments), flatten(Vertices)
lng = ListLength(List=explode_2.Vertices)  # -> expr("(X-1)/2", Length)
int_2 = Integer(lng)
item = ListItem(List=explode_2.Vertices, Index=int_2, Wrap=True)
Y = UnitY(Factor="-1.0")
move = Move(Geometry=item, Motion=Y)  # -> Geometry, Transform
ln = Line(StartPoint=item, EndPoint=move.Geometry)
len_2 = Length(Curve=ln)
division_2 = Division(A=len_2, B="0.25")
int_3 = Integer(division_2)
divide_2 = DivideCurve(Curve=ln, Count=int_3, Kinks=False)  # -> Points, Tangents, Parameters
pline_3 = PolyLine(Vertices=divide_2.Points, Closed=False)
kn = Panel("10")
explode_3 = Explode(Curve=pline_3, Recursive=True)  # -> Segments, Vertices
Z = UnitZ(Factor=expr("-X", 1))
crv = Curve(flatten([explode_2.Segments, explode_3.Segments]))
multiplication = Multiplication(A=Z, B=kn)
pt_5 = Point(move.Geometry)
end = EndPoints(Curve=pline)  # -> Start, End
supportpt = Point([end.Start, end.End])
beam_segments = Curve(crv)
load_vec = Vector(multiplication)
load_pt = Point(pt_5)

# ----
crv_2 = Curve(beam_segments)
beamorientation = BeamOrientation(Line=crv_2, FlipVertical=Toggle(True))  # -> StartPlane, EndPlane
pln = Plane(beamorientation.EndPlane)
pln_2 = Plane(beamorientation.StartPlane)

mat = Materials(MaterialIndex=Slider(0, range=0..10))  # -> MaterialName, Density, YoungsModulus, ShearModulus, Strength
h_mm = Panel("200")
w_mm = Panel("100")
t_mm = Panel("5")
panel = Panel(mat.MaterialName)
rectangle = RectangularCS(Width=w_mm, Height=h_mm, Thickness=t_mm)  # -> A, Iy, Iz, It
beam = Beam(
    StartPlane=pln_2,
    EndPlane=pln,
    EModulus=mat.YoungsModulus,
    GModulus=mat.ShearModulus,
    A=rectangle.A,
    Iy=rectangle.Iy,
    Iz=rectangle.Iz,
    It=rectangle.It)

vec = Vector(load_vec)
pt_6 = Point(load_pt)
N = Vector(expr("X*1e3", vec))
load = Load(Point=pt_6, NodalForce=N)

toggle = BooleanToggle(True)
support6dof = Support6DOF(
    SupportPt=supportpt,
    XFixed=toggle,
    YFixed=toggle,
    ZFixed=toggle,
    RXFixed=Toggle(True),
    RYFixed=Toggle(False),
    RZFixed=Toggle(False),
    Strength="1e9")

duppt = RemoveDuplicatePts(Points=flatten([pln_2, pln]), Tolerance=0.01)
show = Show(G=duppt)

entwine = Entwine(Branch00=show, Branch01=support6dof, Branch02=beam, Branch03=load, FlattenInputs=True)

solver = Solver(GoalObjects=entwine, Reset=Button(), Threshold="1e-20", Tolerance=0.01, On=Toggle(False))  # -> I, V, O

bang = ExplodeTree(Data=solver.O)  # -> Branch0, Branch1, Branch2, Branch3

beamoutput = BeamOutput(BeamData=bang.Branch2)  # -> P0, P1, N, Vy, Vz, Mt, My0, Mz0, My1, Mz1
abs = Absolute(Value=[beamoutput.My0, beamoutput.My1])
abs_2 = Absolute(Value=beamoutput.Vy)
abs_3 = Absolute(Value=beamoutput.Mt)
abs_4 = Absolute(Value=[beamoutput.Mz0, beamoutput.Mz1])
abs_5 = Absolute(Value=beamoutput.Vz)
sort = SortList(Keys=abs)  # -> reverse(Keys), ValuesA
sort_2 = SortList(Keys=abs_2)  # -> reverse(Keys), ValuesA
sort_3 = SortList(Keys=abs_3)  # -> reverse(Keys), ValuesA
sort_4 = SortList(Keys=abs_4)  # -> reverse(Keys), ValuesA
sort_5 = SortList(Keys=abs_5)  # -> reverse(Keys), ValuesA
item_2 = ListItem(List=sort.Keys, Index=0, Wrap=True)
item_3 = ListItem(List=sort_2.Keys, Index=0, Wrap=True)
item_4 = ListItem(List=sort_3.Keys, Index=0, Wrap=True)
item_5 = ListItem(List=sort_4.Keys, Index=0, Wrap=True)
item_6 = ListItem(List=sort_5.Keys, Index=0, Wrap=True)
list = ValueList({"Vy": 0, "Vz": 1, "Mt": 2, "My": 3, "Mz": 4}, selected="My")
ln_2 = Line(StartPoint=beamoutput.P0, EndPoint=beamoutput.P1)
mt_max_knm = Panel(item_4)
my_max_knm = Panel(item_2)
vy_max_kn = Panel(item_3)
vz_max_kn = Panel(item_6)
mz_max_knm = Panel(item_5)
axialdisplay = AxialVisualisation(Line=ln_2, AxialForces=beamoutput.N, ThicknessMax=10)
bendingdisplay = BendingVisualisation6DOF(
    P0=beamoutput.P0,
    P1=beamoutput.P1,
    Vy=beamoutput.Vy,
    Vz=beamoutput.Vz,
    Mt=beamoutput.Mt,
    My0=beamoutput.My0,
    Mz0=beamoutput.Mz0,
    My1=beamoutput.My1,
    Mz1=beamoutput.Mz1,
    Option=list,
    ScaleFactor=Slider(1.5, range=0..10),
    Colour=ColourSwatch(SwatchColor=RGB(0, 187, 255)))

support6dofoutput = Support6DOFOutput(Support6DOFData=bang.Branch1)  # -> SupportPlane, ReactionForce, ReactionMoment
pln_3 = Plane(support6dofoutput.SupportPlane)
vec_2 = Vector(expr("Round(X,1)", support6dofoutput.ReactionMoment))
vec_3 = Vector(expr("Round(X,1)", support6dofoutput.ReactionForce))
vdis = VectorDisplay(Anchor=support6dofoutput.SupportPlane, Vector=expr("X*1e-1", support6dofoutput.ReactionForce))
panel_2 = Panel(vec_3)
global_reaction_moment = Panel(vec_2)

h = Number(expr("X*1e-3", h_mm))
w = Number(expr("X*1e-3", w_mm))
dom = ConstructDomain(DomainStart=expr("-X/2", w), DomainEnd=expr("X/2", w))
dom_2 = ConstructDomain(DomainStart=expr("-X/2", h), DomainEnd=expr("X/2", h))
rectangle_2 = Rectangle(Plane=beamoutput.P0, XSize=dom, YSize=dom_2, Radius=0)  # -> graft(Rectangle), Length
rectangle_3 = Rectangle(Plane=beamoutput.P1, XSize=dom, YSize=dom_2, Radius=0)  # -> graft(Rectangle), Length
loft = Loft(
    Curves=[rectangle_2.Rectangle, rectangle_3.Rectangle],
    Options={Adjust=False, Closed=False, LoftEnds=0, LoftSimp=0, LoftType=0, Rebuild=10, Refit=0.01})

displ = Displacements(InitialPositions=duppt, FinalPositions=bang.Branch0)  # -> TotalDisplacements, MaximumDisplacementX, MaximumDisplacementY, MaximumDisplacementZ
vlen = VectorLength(Vector=displ.TotalDisplacements)
sort_6 = SortList(Keys=vlen, ValuesA=bang.Branch0)  # -> reverse(Keys), reverse(ValuesA)
item_7 = ListItem(List=sort_6.ValuesA, Index=0, Wrap=True)
item_8 = ListItem(List=sort_6.Keys, Index=0, Wrap=True)
int_4 = Integer(item_8)
pt_7 = Point(item_7)
panel_3 = Panel(int_4)
