# Grasshopper definition PrebentLath6DOF.gh (Grasshopper 1.0.7)
# plug-ins: K2Engineering, Kangaroo2 Components

xz = XZPlane(Origin=Point(0, 0, 0))
arc = Arc(Plane=xz, Radius=Slider(5, range=0..10), Angle=Domain(0, 3.141592654))  # -> Arc, Length
# K2ENGINEERING - PREBENT LATH 6 DOF
number_slider = Slider(20, range=0..100)
divide = DivideCurve(Curve=arc.Arc, Count=number_slider, Kinks=False)  # -> Points, Tangents, Parameters
pline = PolyLine(Vertices=divide.Points, Closed=False)  # -> flatten(Polyline)
pi = Pi(Factor=Slider(0.5, range=0..1))
pframe = PerpFrame(Curve=arc.Arc, Parameter=divide.Parameters)
prot = RotatePlane(Plane=pframe, Angle=pi)
explode = Explode(Curve=pline, Recursive=True)  # -> simplify(Segments), Vertices
cull_i = CullIndex(List=prot, Indices="-1", Wrap=True)
shift = ShiftList(List=prot, Shift=1, Wrap=False)
beamorientation = BeamOrientation(Line=explode.Segments, FlipVertical=Toggle(False))  # -> StartPlane, EndPlane
start_plane_average = Plane(cull_i)
end_plane_average = Plane(shift)
start_plane_perp = Plane(beamorientation.StartPlane)
end_plane_perp = Plane(beamorientation.EndPlane)
bending_active = BooleanToggle(True)
filter = StreamFilter(Gate=bending_active, Stream0=start_plane_perp, Stream1=start_plane_average)
filter_2 = StreamFilter(Gate=bending_active, Stream0=end_plane_perp, Stream1=end_plane_average)
start_plane = Plane(filter)
end_plane = Plane(filter_2)

mat = Materials(MaterialIndex=Slider(2, range=0..10))  # -> MaterialName, Density, YoungsModulus, ShearModulus, Strength
h_mm = Panel("50")
w_mm = Panel("100")
panel = Panel(mat.MaterialName)
rectangle = RectangularCS(Width=w_mm, Height=h_mm)  # -> A, Iy, Iz, It
beam = Beam(
    StartPlane=start_plane,
    EndPlane=end_plane,
    EModulus=mat.YoungsModulus,
    GModulus=mat.ShearModulus,
    A=rectangle.A,
    Iy=rectangle.Iy,
    Iz=rectangle.Iz,
    It=rectangle.It)

item = ListItem(List=reverse(end_plane), Index=0, Wrap=True)

item_2 = ListItem(List=start_plane, Index=0, Wrap=True)
toggle = BooleanToggle(True)
pt = Point(flatten([item_2, item]))
support6dof = Support6DOF(
    SupportPt=pt,
    XFixed=toggle,
    YFixed=toggle,
    ZFixed=toggle,
    RXFixed=Toggle(False),
    RYFixed=Toggle(False),
    RZFixed=Toggle(False),
    Strength="1e9")

entwine = Entwine(Branch00=support6dof, Branch01=beam, FlattenInputs=True)
solver = Solver(GoalObjects=entwine, Reset=Button(), Threshold="1e-20", Tolerance=0.01, On=Toggle(False))  # -> I, V, O
bang = ExplodeTree(Data=solver.O)  # -> Branch0, Branch1

support6dofoutput = Support6DOFOutput(Support6DOFData=bang.Branch0)  # -> SupportPlane, ReactionForce, ReactionMoment
vdis = VectorDisplay(Anchor=support6dofoutput.SupportPlane, Vector=support6dofoutput.ReactionForce)

beamoutput = BeamOutput(BeamData=bang.Branch1)  # -> P0, P1, N, Vy, Vz, Mt, My0, Mz0, My1, Mz1
abs = Absolute(Value=[beamoutput.My0, beamoutput.My1])
sort = SortList(Keys=abs)  # -> Keys, ValuesA
item_3 = ListItem(List=reverse(sort.Keys), Index=0, Wrap=True)
ln = Line(StartPoint=beamoutput.P0, EndPoint=beamoutput.P1)
list = ValueList({"Vy": 0, "Vz": 1, "Mt": 2, "My": 3, "Mz": 4}, selected="My")
my_max_knm = Panel(item_3)
axialdisplay = AxialVisualisation(Line=ln, AxialForces=expr("X*1000", beamoutput.N), ThicknessMax=10)
bendingdisplay = BendingVisualisation6DOF(
    P0=beamoutput.P0,
    P1=beamoutput.P1,
    Vy=beamoutput.Vy,
    Vz=beamoutput.Vz,
    Mt=beamoutput.Mt,
    My0=beamoutput.My0,
    Mz0=beamoutput.Mz0,
    My1=beamoutput.My1,
    Mz1=beamoutput.Mz1,
    Option=list,
    ScaleFactor=Slider(2, range=0..10),
    Colour=ColourSwatch(SwatchColor=RGB(0, 187, 255)))

h = Number(expr("X*1e-3", h_mm))
w = Number(expr("X*1e-3", w_mm))
dom = ConstructDomain(DomainStart=expr("-X/2", w), DomainEnd=expr("X/2", w))
dom_2 = ConstructDomain(DomainStart=expr("-X/2", h), DomainEnd=expr("X/2", h))
rectangle_2 = Rectangle(Plane=beamoutput.P0, XSize=dom, YSize=dom_2, Radius=0)  # -> graft(Rectangle), Length
rectangle_3 = Rectangle(Plane=beamoutput.P1, XSize=dom, YSize=dom_2, Radius=0)  # -> graft(Rectangle), Length
loft = Loft(
    Curves=[rectangle_2.Rectangle, rectangle_3.Rectangle],
    Options={Adjust=False, Closed=False, LoftEnds=0, LoftSimp=0, LoftType=0, Rebuild=10, Refit=0.01})
