# Grasshopper definition Truss.gh (Grasshopper 0.9.76)
# plug-ins: K2Engineering, Kangaroo Components, Kangaroo2 Components

# ---- group: Truss geometry
truss_elements = Curve([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])
# K2ENGINEERING - TRUSS
support_pts = Point([Point(5, 0, 0), Point(0, 0, 0)])
load_pt = Point(Point(2.5, 0, 0.5))

# ----
mat = Materials(MaterialIndex=Slider(0, range=0..5))  # -> MaterialName, Density, YoungsModulus, Strength
circle = CircularCS(Diameter=Slider(40, range=0..100), Thickness=Slider(5, range=0..10))  # -> Area, Inertia, ZDist
panel = Panel(mat.MaterialName)
bar = Bar(Line=truss_elements, EModulus=mat.YoungsModulus, Area=circle.Area)

# ---- group: Selfweight of truss
# Make sure that the unit
# in Rhino is in meters
blength = BarLength(Bars=truss_elements)  # -> Points, NodalLengths
bselfweight = BarSelfweight(NodalLengths=blength.NodalLengths, CrossSectionArea=circle.Area, MaterialDensity=mat.Density)
ma = MassAddition(Input=bselfweight)  # -> Result, PartialResults
load = Load(Point=blength.Points, NodalForce=bselfweight)
vdis = VectorDisplay(Anchor=blength.Points, Vector=expr("X/100", bselfweight))
vlen = VectorLength(Vector=ma.Result)
kn = Number(expr("X*1e-3", vlen))
total_weight_kn = Panel(kn)

# ---- group: Point load
size_n = Panel("50.0e3")
pt = Point(load_pt)
Z = UnitZ(Factor=size_n)  # -> expr("-X", UnitVector)
kn_2 = Number(expr("X*1e-3", size_n))
vdis_2 = VectorDisplay(Anchor=pt, Vector=expr("X/50000", Z))
load_2 = Load(Point=pt, NodalForce=Z)

# ----
end = EndPoints(Curve=truss_elements)  # -> Start, End
duppt = RemoveDuplicatePts(Points=[end.Start, end.End], Tolerance=0.01)
allpts = Point(duppt)
show = Show(G=allpts)

# ---- group: Pinned and roller support
item = ListItem(List=support_pts, Index=0, Wrap=True)  # -> Item, Item1
support = Support(PinnedSupportPt=item.Item1, XFixed=Toggle(False), YFixed=True, ZFixed=True, Strength="1e9")
support_2 = Support(PinnedSupportPt=item.Item, XFixed=True, YFixed=True, ZFixed=True, Strength=1e+15)

# ----
addition = Addition(A=kn, B=kn_2)
num = Number(expr("X/2", addition))
load_sum_kn = Panel(addition)
reaction_force_kn = Panel(num)
entwine = Entwine(Branch00=show, Branch01=[support_2, support], Branch02=bar, Branch03=[load, load_2], FlattenInputs=True)
solver = Solver(GoalObjects=entwine, Reset=Button(), Threshold="1e-15", Tolerance=0.01, On=Toggle(False))  # -> I, V, O
bang = ExplodeTree(Data=solver.O)  # -> Branch0, Branch1, Branch2, Branch3

# ---- group: Axial forces
baroutput = BarOutput(BarData=bang.Branch2)  # -> PIndexStart, PIndexEnd, Line, AxialForce, AxialStress
abs = Absolute(Value=baroutput.AxialStress)
sort = SortList(Keys=abs)  # -> reverse(Keys), ValuesA
curvepoint = PointOnCurve(baroutput.Line, parameter=0.5)
axialdisplay = AxialVisualisation(Line=baroutput.Line, AxialStresses=baroutput.AxialStress)
number_slider = Slider(0.044, range=0..1)
expression = Expression(x=baroutput.AxialForce, Expression="Round(x,1)")
fy = Number(expr("X/1.2", mat.Strength))
item_2 = ListItem(List=sort.Keys, Index=0, Wrap=True)
xz = XZPlane(Origin=curvepoint)
division = Division(A=item_2, B=fy)
tag = TextTag3D(Location=xz, Text=expression, Size=number_slider, Colour=ColourSwatch(SwatchColor=RGB(0, 0, 0)), Justification=8)
max_util = Panel(division)

# ---- group: Reaction forces
supportoutput = SupportOutput(SupportData=bang.Branch1)  # -> SupportPt, ReactionForce
vdis_3 = VectorDisplay(Anchor=supportoutput.SupportPt, Vector=expr("X/30", supportoutput.ReactionForce))
expression_2 = Expression(x=supportoutput.ReactionForce, Expression="Round(x,1)")
xz_2 = XZPlane(Origin=supportoutput.SupportPt)
tag_2 = TextTag3D(Location=xz_2, Text=expression_2, Size=number_slider, Colour=ColourSwatch(SwatchColor=RGB(0, 255, 174)), Justification=5)

# ---- group: Displacements
range = Range(Domain=Domain(0, 1), Steps=expr("20", 10))
displ = Displacements(InitialPositions=allpts, FinalPositions=bang.Branch0)  # -> TotalDisplacements, MaximumDisplacementX, MaximumDisplacementY, MaximumDisplacementZ
gradient = Gradient(LowerLimit=0, UpperLimit=1, Parameter=range, stops=[0: RGB(0, 128, 0), 0.5: RGB(255, 255, 0), 1: RGB(255, 0, 0)])
displ_mm = Panel(displ.MaximumDisplacementZ)
vlen_2 = VectorLength(Vector=displ.TotalDisplacements)
displvis = DisplacementVisualisation(Lines=baroutput.Line, DisplacedNodes=bang.Branch0, Displacement=vlen_2, ColourRange=gradient)
